% Simulink data dictionary Data_Param.sldd

busParam = Simulink.Bus()
  lever_arm: Bus: busParam_lever_arm
  max_iterations: int32
  controller: Bus: busParam_controller

busParam_controller = Simulink.Bus()
  Kp: single[3 3]
  Ki: single[3 3]

busParam_lever_arm = Simulink.Bus()
  sensor1: double[3 1]
  sensor2: double[3 1]

datastoreParam = Simulink.Signal(InitialValue="structParam", DataType="Bus: busParam")  % Data store name consistent with bus "busParam" and struct "structParam"

structParam = struct(
  lever_arm=struct(sensor1=[1; 0; 3], sensor2=[-1; 0; 3]),
  max_iterations=int32(100),
  controller=struct(Kp=single([1 0 0; 0 1 0; 0 0 1]), Ki=single(repmat(0, 3, 3))))